# Grasshopper definition TAG-IT.gh (Grasshopper 1.0.7)
# plug-ins: Rhino.Inside for Autodesk Revit

author_s = Panel("Elton Gjata")
# Output
# For groups that bake geometry out to Rhino or export data to external programs
gh_version = Panel("1.0.0007")
# Good Practice
# Guidelines
# 1. Divide the script into the user interface and the back end.
# 
# 2. Build the script with small groups of nodes
# 
# 3. Groups should always have input/output
# 
# 4. Rename the input/output containers to the data they carry
# 
# 5. Color code groups according to the categories in the template
# DESCRIPTION:: facade schemes for 8th pine commercial scheme facade
search_tags = Panel("")
# Monitor
# Display data that is helpful in creating or running the script
# ADDITIONAL ASSETS REQUIRED:: Rhino File Location:
# Other Required Files:
required_plugins = Panel("i.e. Ladybug 0.9")
# Annotation
# For comments and explanation
# Work-In-Progress
# For portions of the script that are not yet completed or are not working as intended
notes_issues = Panel("")

# ----
# ######.### PROJECT NAME: Study Name
# Design
# Control
# For user input (such as sliders, numbers...)
# Input
# For user input (such as sliders, numbers...)
panel = Panel("For Back-End Functionality")

# ----
# 1 - FIND  CURRENT ACTIVE SHEET VIEW
# 2 - LOAD JSON
active_graphical_view = ActiveGraphicalView()

# ----
# 4 - ADD CLOUD
geometry = Geometry(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)
view = View(active_graphical_view)
boundary_surfaces = BoundarySurfaces(Edges=geometry)
stream_filter = StreamFilter(Gate=Toggle(False), Stream0=boundary_surfaces)
add_revision_cloud = AddRevisionCloud(View=view, Boundary=stream_filter, TrackingMode=2)

view_2 = View(active_graphical_view)

# ---- group: TEXT
# 2 - ADD TEXT
text_type = Type(<textelementtype referenced from the Revit model>)
enable = BooleanToggle(False)
point = Point(Point(0, 0, 0))
stream_filter_2 = StreamFilter(Gate=enable, Stream0="TEST COMMENT")
add_text = AddText(View=view_2, Point=point, Content=stream_filter_2, Type=text_type, TrackingMode=1)

# ----
# 3 - ADD LINEWORK
boolean_toggle = BooleanToggle(False)
geometry_2 = Geometry(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)
view_3 = View(active_graphical_view)
stream_filter_3 = StreamFilter(Gate=boolean_toggle, Stream0=geometry_2)
add_detail_line = AddDetailLine(View=view_3, Curve=stream_filter_3, TrackingMode=1)

# ----
# 4 - ADD DIMENSION
point_2 = Point()
point_3 = Point()
view_4 = View(active_graphical_view)
line = Line()
merge = Merge(Data1=point_2, Data2=point_3)
add_linear_dimension = AddLinearDimension(View=view_4, References=merge, Line=line, TrackingMode=2)

sheet = Sheet(<sheet referenced from the Revit model>)

# ----
# 2B - ADD TEXT ANNOTATION LEADERS
add_leader = BooleanToggle(False)
text_note = TextNote(add_text)
point_4 = Point()
point_5 = Point()
point_6 = Point()
annotation_leaders = AnnotationLeaders(Annotation=text_note, Leader=add_leader, ShoulderLocations=point_6, EndLocations=point_4, TextLocations=point_5)  # -> Annotation, Leader, ShoulderLocations, EndLocations, TextLocations

# ----
# 3B - CHANGE LINE STYLE
line_style = LineStyle(<line style referenced from the Revit model>)
panel_2 = Panel(line_style)
curve_line_style = CurveLineStyle(Element=add_detail_line, LineStyle=line_style)  # -> Element, LineStyle

# ----
# OVERRIDE ELEMENT GRAPHICS IN VIEW
graphic_overrides = GraphicOverrides()  # -> Overrides, Halftone, ProjectionLinesPattern, ProjectionLinesColor, ProjectionLinesWeight, SurfacePatternsForegroundVisible, SurfacePatternsForegroundPattern, SurfacePatternsForegroundColor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
hide = BooleanToggle(False)
view_5 = View(active_graphical_view)
element = Element(add_linear_dimension)
element_graphic_overrides = ElementGraphicOverrides(View=view_5, Element=element, Hidden=hide, Overrides=graphic_overrides.Overrides)  # -> View, Element, Hidden, Overrides; disabled
